% Requirement links of MotorController.slx (R2022a)

block :13 implements Syringe Infusion Pump Delivery Logic Requirement.docx#@Simulink_requirement_item_47: Voltage Command Rate Limitation
block :14 implements Syringe Infusion Pump Delivery Logic Requirement.docx#@Simulink_requirement_item_38: Reference motor speed limit
block :15 implements Syringe Infusion Pump Delivery Logic Requirement.docx#@Simulink_requirement_item_40: Feedforward lookup table based on reference motor speed
block :3 implements Syringe Infusion Pump Delivery Logic Requirement.docx#@Simulink_requirement_item_46: Superimpose Command
block :4 implements Syringe Infusion Pump Delivery Logic Requirement.docx#@Simulink_requirement_item_39: Reference motor speed filter
block :5 implements Syringe Infusion Pump Delivery Logic Requirement.docx#@Simulink_requirement_item_41: Feedback Controller