% Requirement links of OcclusionDetection.slx (R2022a)

block :1 implements Syringe_Infusion_Pump_Delivery_Logic_Requirement.slreqx#18: Feedback: Angular Speed
block :18 implements Syringe_Infusion_Pump_Delivery_Logic_Requirement.slreqx#66: Occlusion Detection Option 2
block :2 implements Syringe_Infusion_Pump_Delivery_Logic_Requirement.slreqx#20: Feedback: Force Sensor
block :3 implements Syringe_Infusion_Pump_Delivery_Logic_Requirement.slreqx#65: Occlusion Detection Option 1