% Requirement links of Supervisory.slx (R2022a)

block :18 implements Syringe_Infusion_Pump_Delivery_Logic_Requirement.slreqx#48: Units conversion
block :21 implements Syringe_Infusion_Pump_Delivery_Logic_Requirement.slreqx#51: Composition of delivery rate
block :22 implements Syringe_Infusion_Pump_Delivery_Logic_Requirement.slreqx#50: Convert Basal Rate
block :31 implements Syringe_Infusion_Pump_Delivery_Logic_Requirement.slreqx#49: Convert Bolus Magnitude
block :6 implements Syringe_Infusion_Pump_Delivery_Logic_Requirement.slreqx#43: Basal Control Chart
block :6:11 implements Syringe_Infusion_Pump_Delivery_Logic_Requirement.slreqx#47: Algorithm to determine when to start and stop basal delivery
block :6:22 implements Syringe_Infusion_Pump_Delivery_Logic_Requirement.slreqx#46: System available conditions
block :6:3 implements Syringe_Infusion_Pump_Delivery_Logic_Requirement.slreqx#44: System off before start-up
block :6:3 implements Syringe_Infusion_Pump_Delivery_Logic_Requirement.slreqx#44: System off before start-up
block :6:5 implements Syringe_Infusion_Pump_Delivery_Logic_Requirement.slreqx#45: System armed after start-up
block :7 implements Syringe_Infusion_Pump_Delivery_Logic_Requirement.slreqx#24: Bolus Control Chart
block :7:1 implements Syringe_Infusion_Pump_Delivery_Logic_Requirement.slreqx#25: System off before start-up
block :7:281 implements Syringe_Infusion_Pump_Delivery_Logic_Requirement.slreqx#36: Quick Bolus Mode
block :7:3 implements Syringe_Infusion_Pump_Delivery_Logic_Requirement.slreqx#26: System armed after start-up
block :7:317 implements Syringe_Infusion_Pump_Delivery_Logic_Requirement.slreqx#40: Number of repeating cycle is finished
block :7:318 implements Syringe_Infusion_Pump_Delivery_Logic_Requirement.slreqx#41: There is not enough unit remaining to finish the next cycle
block :7:319 implements Syringe_Infusion_Pump_Delivery_Logic_Requirement.slreqx#42: The occlusion is detected to be occurring.
block :7:325 implements Syringe_Infusion_Pump_Delivery_Logic_Requirement.slreqx#37: Quick Bolus Mode Inactive when initially armed
block :7:326 implements Syringe_Infusion_Pump_Delivery_Logic_Requirement.slreqx#38: Quick Bolus Mode active when triggered
block :7:334 implements Syringe_Infusion_Pump_Delivery_Logic_Requirement.slreqx#27: Normal Bolus Mode
block :7:344 implements Syringe_Infusion_Pump_Delivery_Logic_Requirement.slreqx#32: Deactivate Normal Bolus Mode
block :7:346 implements Syringe_Infusion_Pump_Delivery_Logic_Requirement.slreqx#32: Deactivate Normal Bolus Mode
block :7:347 implements Syringe_Infusion_Pump_Delivery_Logic_Requirement.slreqx#32: Deactivate Normal Bolus Mode
block :7:349 implements Syringe_Infusion_Pump_Delivery_Logic_Requirement.slreqx#32: Deactivate Normal Bolus Mode
block :7:350 implements Syringe_Infusion_Pump_Delivery_Logic_Requirement.slreqx#32: Deactivate Normal Bolus Mode
block :7:352 implements Syringe_Infusion_Pump_Delivery_Logic_Requirement.slreqx#32: Deactivate Normal Bolus Mode
block :7:364 implements Syringe_Infusion_Pump_Delivery_Logic_Requirement.slreqx#35: The occlusion is detected to be occurring.
block :7:364 implements Syringe_Infusion_Pump_Delivery_Logic_Requirement.slreqx#32: Deactivate Normal Bolus Mode
block :7:365 implements Syringe_Infusion_Pump_Delivery_Logic_Requirement.slreqx#34: There is not enough unit remaining to finish the next cycle
block :7:365 implements Syringe_Infusion_Pump_Delivery_Logic_Requirement.slreqx#32: Deactivate Normal Bolus Mode
block :7:366 implements Syringe_Infusion_Pump_Delivery_Logic_Requirement.slreqx#33: Number of repeating cycle is finished
block :7:366 implements Syringe_Infusion_Pump_Delivery_Logic_Requirement.slreqx#32: Deactivate Normal Bolus Mode
block :7:367 implements Syringe_Infusion_Pump_Delivery_Logic_Requirement.slreqx#30: During Bolus Delivery
block :7:368 implements Syringe_Infusion_Pump_Delivery_Logic_Requirement.slreqx#29: Normal Bolus Mode active when triggered
block :7:369 implements Syringe_Infusion_Pump_Delivery_Logic_Requirement.slreqx#31: Pause After Bolus Delivery
block :7:370 implements Syringe_Infusion_Pump_Delivery_Logic_Requirement.slreqx#28: Normal Bolus Mode Inactive when initially armed
urn:uuid::41.1 implements Syringe_Infusion_Pump_Delivery_Logic_Requirement.slreqx#@Simulink_requirement_item_62: Simulink_requirement_item_62: Occlusion Detection Option 2
urn:uuid::41.2 implements Syringe_Infusion_Pump_Delivery_Logic_Requirement.slreqx#@Simulink_requirement_item_62: Simulink_requirement_item_62: Occlusion Detection Option 2
urn:uuid::41.3 implements Syringe_Infusion_Pump_Delivery_Logic_Requirement.slreqx#@Simulink_requirement_item_62: Simulink_requirement_item_62: Occlusion Detection Option 2
urn:uuid::41.4 implements Syringe_Infusion_Pump_Delivery_Logic_Requirement.slreqx#@Simulink_requirement_item_31: Simulink_requirement_item_31: Algorithm to determine when to start and stop basal delivery
urn:uuid::41.5 implements Syringe_Infusion_Pump_Delivery_Logic_Requirement.slreqx#@Simulink_requirement_item_31: Simulink_requirement_item_31: Algorithm to determine when to start and stop basal delivery
urn:uuid::41.6 implements Syringe_Infusion_Pump_Delivery_Logic_Requirement.slreqx#@Simulink_requirement_item_31: Simulink_requirement_item_31: Algorithm to determine when to start and stop basal delivery