# Requirement set Syringe_Infusion_Pump_Delivery_Logic_Requirement (R2022a)

## 1 [Syringe_Infusion_Pump_Delivery_Logic_Requirement] References to Syringe Infusion Pump Delivery Logic Requirement.docx
References to Microsoft Word document
C:\Users\szhang\Documents\MATLAB\InfusionPumpSeminar\Documents\Syringe Infusion Pump Delivery Logic Requirement.docx
Comment: Updated the element with id 1. Architecture, property description
Updated the element with id Simulink_requirement_item_58, property description
Updated the element with id Simulink_requirement_item_1, property description
Updated the element with id Simulink_requirement_item_60, property description
Updated the element with id Simulink_requirement_item_59, property description
Updated the element with id Simulink_requirement_item_17, property description
Updated the element with id Simulink_requirement_item_2, property description
Updated the element with id Simulink_requirement_item_37, property description
Updated the element with id Simulink_requirement_item_52, property description
Updated the element with id Simulink_requirement_item_18, property description
Updated the element with id Simulink_requirement_item_27, property description
Updated the element with id Simulink_requirement_item_38, property description
Updated the element with id 1.3 Outputs, property description
Updated the element with id Simulink_requirement_item_3, property description
Updated the element with id Simulink_requirement_item_57, property description
Updated the element with id Simulink_requirement_item_14, property description
Updated the element with id Simulink_requirement_item_16, property description
Updated the element with id Simulink_requirement_item_19, property description
Updated the element with id Simulink_requirement_item_28, property description
Updated the element with id Simulink_requirement_item_61, property description
Updated the element with id Simulink_requirement_item_39, property description
Updated the element with id Simulink_requirement_item_32, property description
Updated the element with id Simulink_requirement_item_4, property description
Updated the element with id Simulink_requirement_item_33, property description
Updated the element with id Simulink_requirement_item_15, property description
Updated the element with id Simulink_requirement_item_20, property description
Updated the element with id Simulink_requirement_item_29, property description
Updated the element with id Simulink_requirement_item_40, property description
Updated the element with id Simulink_requirement_item_62, property description
Updated the element with id Simulink_requirement_item_21, property description
Updated the element with id Simulink_requirement_item_5, property description
Updated the element with id Simulink_requirement_item_34, property description
Updated the element with id Simulink_requirement_item_48, property description
Updated the element with id Simulink_requirement_item_30, property description
Updated the element with id Simulink_requirement_item_49, property description
Updated the element with id Simulink_requirement_item_22, property description
Updated the element with id Simulink_requirement_item_41, property description
Updated the element with id Simulink_requirement_item_31, property description
Updated the element with id Simulink_requirement_item_35, property description
Updated the element with id Simulink_requirement_item_6, property description
Updated the element with id Simulink_requirement_item_42, property description
Updated the element with id Simulink_requirement_item_50, property description
Updated the element with id Simulink_requirement_item_23, property description
Updated the element with id Simulink_requirement_item_46, property description
Updated the element with id Simulink_requirement_item_36, property description
Updated the element with id Simulink_requirement_item_43, property description
Updated the element with id Simulink_requirement_item_7, property description
Updated the element with id 2.1.4.3 Deactivate Quick Bolus Mode, property description
Updated the element with id Simulink_requirement_item_24, property description
Updated the element with id Simulink_requirement_item_47, property description
Updated the element with id Simulink_requirement_item_54, property description
Updated the element with id Simulink_requirement_item_8, property description
Updated the element with id Simulink_requirement_item_44, property description
Updated the element with id Simulink_requirement_item_63, property description
Updated the element with id Simulink_requirement_item_55, property description
Updated the element with id Simulink_requirement_item_9, property description
Updated the element with id Simulink_requirement_item_25, property description
Updated the element with id Simulink_requirement_item_45, property description
Updated the element with id Simulink_requirement_item_26, property description
Updated the element with id Simulink_requirement_item_56, property description
Updated the element with id Simulink_requirement_item_10, property description
Updated the element with id Simulink_requirement_item_53, property description
Updated the element with id Simulink_requirement_item_11, property description
Updated the element with id Simulink_requirement_item_13, property description
Updated the element with id Simulink_requirement_item_12, property description
Comment: Updated the element with id Simulink_requirement_item_62, property description

### 1.1 [1. Architecture]

#### 1.1.1 [Simulink_requirement_item_58] Command Inputs
1.1 Command Inputs <http://localhost:31415/matlab/feval/rmiobjnavigate?arguments=%5b%22InfusionPumpSoftwareModel.slx%22,%22:274%22%5d>
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
##### 1.1.1.1 [Simulink_requirement_item_1] Enable Disable Switch
1.1.1 Enable/Disable Switch
The controller shall have an On/Off Switch to enable/disable the operation of the infusion pump system.

##### 1.1.1.2 [Simulink_requirement_item_2] Bolus Type
1.1.2 Bolus Type
The controller shall have the capability to control how the bolus can be delivered. When the bolus bype is 0 no bolus shall be delivered. When bolus type is 1, a single pulse can be generated to deliver a bolus. When the bolus type is 2, the pulses can be configured to have different intensity and duration for four sections.

##### 1.1.1.3 [Simulink_requirement_item_3] Number of Repeating Cycles
1.1.3 Number of Repeating Cycles
The controller shall have the capability to control the number of repeating cycles of the bolus type.

##### 1.1.1.4 [Simulink_requirement_item_4] Bolus Delivery Action Trigger
1.1.4 Bolus Delivery Action Trigger
The controller shall have the capability to control when to trigger the bolus delivery.

##### 1.1.1.5 [Simulink_requirement_item_5] Normal Bolus Magnitude
1.1.5 Normal Bolus Magnitude
The controller shall have the capability to control how many units of medicine can be delivered in one pulse of the normal bolus mode.

##### 1.1.1.6 [Simulink_requirement_item_6] Normal Bolus Duration
1.1.6 Normal Bolus Duration
The controller shall have the capability to control the duration of the normal bolus pulse.

##### 1.1.1.7 [Simulink_requirement_item_7] Quick Bolus Magnitude
1.1.7 Quick Bolus Magnitude
The controller shall have the capability to control how many units of medicine can be delivered in each pulse of the quick bolus mode.

##### 1.1.1.8 [Simulink_requirement_item_8] Quick Bolus Duration
1.1.8 Quick Bolus Duration
The controller shall have the capability to control the duration of the quick bolus pulses.

##### 1.1.1.9 [Simulink_requirement_item_9] Pause Time
1.1.9 Pause Time
The controller shall have the capability to control how long the system will pause between pulses.

##### 1.1.1.10 [Simulink_requirement_item_10] Lower Limit
1.1.10 Lower Limit
The controller shall have the capability to set the lower limit of the remaining unit of the reservoir.

##### 1.1.1.11 [Simulink_requirement_item_11] Basal Delivery Action Trigger
1.1.11 Basal Delivery Action Trigger
The controller shall have the capability to control when to trigger basal delivery and stop basal delivery.

##### 1.1.1.12 [Simulink_requirement_item_13] Maximum Basal Delivery Rate
1.1.12 Maximum Basal Delivery Rate
The controller shall have the capability to set the maximum allowable value for basal rate. The value should be between 0 and 2 unit/hr

##### 1.1.1.13 [Simulink_requirement_item_12] Basal Delivery Rate Setting
1.1.13 Basal Delivery Rate Setting
The controller shall have the capability to set the basal delivery rate.

#### 1.1.2 [Simulink_requirement_item_59] Feedback Input
1.2 Feedback Input <http://localhost:31415/matlab/feval/rmiobjnavigate?arguments=%5b%22InfusionPumpSoftwareModel.slx%22,%22:272%22%5d>
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
##### 1.1.2.1 [Simulink_requirement_item_52] Feedback Angular Speed
1.2.1 Feedback: Angular Speed <http://localhost:31415/matlab/feval/rmiobjnavigate?arguments=%5b%22OcclusionDetection.slx%22,%22:1%22%5d>
The controller shall react to the speed sensor.
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
##### 1.1.2.2 [Simulink_requirement_item_14] Feedback Piston Position
1.2.2 Feedback: Piston Position <http://localhost:31415/matlab/feval/rmiobjnavigate?arguments=%5b%22InfusionPumpSoftwareModel.slx%22,%22:58%22%5d>
The controller shall react to the current piston position.
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
##### 1.1.2.3 [Simulink_requirement_item_15] Feedback Force Sensor
1.2.3 Feedback: Force Sensor <http://localhost:31415/matlab/feval/rmiobjnavigate?arguments=%5b%22OcclusionDetection.slx%22,%22:2%22%5d>
The controller shall react to delivery line pressure
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
#### 1.1.3 [1.3 Outputs]

##### 1.1.3.1 [Simulink_requirement_item_16] Motor Control Voltage
1.3.1 Motor Control Voltage <http://localhost:31415/matlab/feval/rmiobjnavigate?arguments=%5b%22InfusionPumpSoftwareModel.slx%22,%22:97%22%5d>
The controller shall be able to control the voltage of the DC motor.
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
### 1.2 [Simulink_requirement_item_60] Supervisory Logic
2. Supervisory Logic <http://localhost:31415/matlab/feval/rmiobjnavigate?arguments=%5b%22InfusionPumpSoftwareModel.slx%22,%22:308%22%5d>
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
#### 1.2.1 [Simulink_requirement_item_17] Bolus Control Chart
2.1 Bolus Control Chart <http://localhost:31415/matlab/feval/rmiobjnavigate?arguments=%5b%22Supervisory.slx%22,%22:7%22%5d>
Based on the input settings the controller shall control accurately how the bolus would be delivered.
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
##### 1.2.1.1 [Simulink_requirement_item_18] System off before start-up
2.1.1 System off before start-up <http://localhost:31415/matlab/feval/rmiobjnavigate?arguments=%5b%22Supervisory.slx%22,%22:7:1%22%5d>
The bolus delivery shall be disabled before turned on.
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
##### 1.2.1.2 [Simulink_requirement_item_19] System armed after start-up
2.1.2 System armed after start-up <http://localhost:31415/matlab/feval/rmiobjnavigate?arguments=%5b%22Supervisory.slx%22,%22:7:3%22%5d>
The bolus delivery shall be armed but not active after start-up
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
##### 1.2.1.3 [Simulink_requirement_item_20] Normal Bolus Mode
2.1.3 Normal Bolus Mode <http://localhost:31415/matlab/feval/rmiobjnavigate?arguments=%5b%22Supervisory.slx%22,%22:7:334%22%5d>
Normal bolus mode shall be armed only when delivery type is set to 1. The delivery action must be triggered.
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
###### 1.2.1.3.1 [Simulink_requirement_item_21] Normal Bolus Mode Inactive when initially armed
2.1.3.1 Normal Bolus Mode Inactive when initially armed <http://localhost:31415/matlab/feval/rmiobjnavigate?arguments=%5b%22Supervisory.slx%22,%22:7:370%22%5d>
When normal bolus mode is initially armed, no bolus should be delivered.
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
###### 1.2.1.3.2 [Simulink_requirement_item_22] Normal Bolus Mode active when triggered
2.1.3.2 Normal Bolus Mode active when triggered <http://localhost:31415/matlab/feval/rmiobjnavigate?arguments=%5b%22Supervisory.slx%22,%22:7:368%22%5d>
After triggered, bolus can be delivered. The number repeating cycle will be cleaned every time it is triggered. This mode is only possible when the unit remaining is enough for at least one cycle.
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
###### 1.2.1.3.3 [Simulink_requirement_item_23] During Bolus Delivery
2.1.3.3 During Bolus Delivery <http://localhost:31415/matlab/feval/rmiobjnavigate?arguments=%5b%22Supervisory.slx%22,%22:7:367%22%5d>
During one cycle of bolus delivery, the stroke magnitude will be calculated based on how many units is set to be completed in the set duration. This states is only available when the desired number of cycles is not yet completed.
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
###### 1.2.1.3.4 [Simulink_requirement_item_24] Pause After Bolus Delivery
2.1.3.4 Pause After Bolus Delivery <http://localhost:31415/matlab/feval/rmiobjnavigate?arguments=%5b%22Supervisory.slx%22,%22:7:369%22%5d>
During the pause section of one cycle, no bolus should be delivered. This states is only available when the number of repeating cycle is not finished.
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
###### 1.2.1.3.5 [Simulink_requirement_item_63] Deactivate Normal Bolus Mode
2.1.3.5 Deactivate Normal Bolus Mode <http://localhost:31415/matlab/feval/rmiobjnavigate?arguments=%5b%22Supervisory.slx%22,%22:7:366%22,%22:7:365%22,%22:7:349%22,%22:7:350%22,%22:7:344%22,%22:7:346%22,%22:7:347%22,%22:7:352%22,%22:7:364%22%5d>
There are conditions the normal bolus mode can return to the inactive state:
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
###### 1.2.1.3.5.1 [Simulink_requirement_item_25] Number of repeating cycle is finished
1. Number of repeating cycle is finished <http://localhost:31415/matlab/feval/rmiobjnavigate?arguments=%5b%22Supervisory.slx%22,%22:7:366%22%5d>
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
###### 1.2.1.3.5.2 [Simulink_requirement_item_26] There is not enough unit remaining to finish the next cycle
2. There is not enough unit remaining to finish the next cycle <http://localhost:31415/matlab/feval/rmiobjnavigate?arguments=%5b%22Supervisory.slx%22,%22:7:365%22%5d>
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
###### 1.2.1.3.5.3 [Simulink_requirement_item_53] The occlusion is detected to be occurring.
3. The occlusion is detected to be occurring. <http://localhost:31415/matlab/feval/rmiobjnavigate?arguments=%5b%22Supervisory.slx%22,%22:7:364%22%5d>
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
##### 1.2.1.4 [Simulink_requirement_item_48] Quick Bolus Mode
2.1.4 Quick Bolus Mode <http://localhost:31415/matlab/feval/rmiobjnavigate?arguments=%5b%22Supervisory.slx%22,%22:7:281%22%5d>
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
###### 1.2.1.4.1 [Simulink_requirement_item_49] Quick Bolus Mode Inactive when initially armed
2.1.4.1 Quick Bolus Mode Inactive when initially armed <http://localhost:31415/matlab/feval/rmiobjnavigate?arguments=%5b%22Supervisory.slx%22,%22:7:325%22%5d>
When quick bolus mode is initially armed, no bolus should be delivered.
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
###### 1.2.1.4.2 [Simulink_requirement_item_50] Quick Bolus Mode active when triggered
2.1.4.2 Quick Bolus Mode active when triggered <http://localhost:31415/matlab/feval/rmiobjnavigate?arguments=%5b%22Supervisory.slx%22,%22:7:326%22%5d>
After triggered, bolus can be delivered. The number repeating cycle will be cleaned every time it is triggered. This mode is only possible when the unit remaining is enough for at least one cycle.
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
###### 1.2.1.4.3 [2.1.4.3 Deactivate Quick Bolus Mode]
There are conditions the normal bolus mode can return to the inactive state:

###### 1.2.1.4.3.1 [Simulink_requirement_item_54] Number of repeating cycle is finished
1. Number of repeating cycle is finished <http://localhost:31415/matlab/feval/rmiobjnavigate?arguments=%5b%22Supervisory.slx%22,%22:7:317%22%5d>
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
###### 1.2.1.4.3.2 [Simulink_requirement_item_55] There is not enough unit remaining to finish the next cycle
2. There is not enough unit remaining to finish the next cycle <http://localhost:31415/matlab/feval/rmiobjnavigate?arguments=%5b%22Supervisory.slx%22,%22:7:318%22%5d>
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
###### 1.2.1.4.3.3 [Simulink_requirement_item_56] The occlusion is detected to be occurring.
3. The occlusion is detected to be occurring. <http://localhost:31415/matlab/feval/rmiobjnavigate?arguments=%5b%22Supervisory.slx%22,%22:7:319%22%5d>
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
#### 1.2.2 [Simulink_requirement_item_27] Basal Control Chart
2.2 Basal Control Chart <http://localhost:31415/matlab/feval/rmiobjnavigate?arguments=%5b%22Supervisory.slx%22,%22:6%22%5d>
Based on the input settings the controller shall control accurately how the basal would be delivered.
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
##### 1.2.2.1 [Simulink_requirement_item_28] System off before start-up
2.2.1 System off before start-up <http://localhost:31415/matlab/feval/rmiobjnavigate?arguments=%5b%22Supervisory.slx%22,%22:6:3%22%5d>
The basal delivery shall be disabled before turned on.
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
##### 1.2.2.2 [Simulink_requirement_item_29] System armed after start-up
2.2.2 System armed after start-up <http://localhost:31415/matlab/feval/rmiobjnavigate?arguments=%5b%22Supervisory.slx%22,%22:6:5%22%5d>
The basal delivery shall be armed but not active after start-up
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
##### 1.2.2.3 [Simulink_requirement_item_30] System available conditions
2.2.3 System available conditions <http://localhost:31415/matlab/feval/rmiobjnavigate?arguments=%5b%22Supervisory.slx%22,%22:6:22%22%5d>
In this stage there should be no basal delivery.
1. Before the entering the state ready to start basal delivery, the algorithm is going to check if the remaining amount is above the set lower limit.
2. There should be no occlusion detected.
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
##### 1.2.2.4 [Simulink_requirement_item_31] Algorithm to determine when to start and stop basal delivery
2.2.4 Algorithm to determine when to start and stop basal delivery <http://localhost:31415/matlab/feval/rmiobjnavigate?arguments=%5b%22Supervisory.slx%22,%22:6:11%22%5d>
The supervisory logic should determine when to start and stop basal delivery based on setting and feedback from the rest of the system. Here are the conditions that could check condition change:
1. Start condition: when the prerequisite of remaining amount is satisfied, the starting point of basal delivery should be triggered by Basal Active signal turn from false to true.
2. Stop condition:
a. User should be able to stop basal delivery by turn Basal Active Signal from true to false
b. During basal delivery, if the remaining amount is below the set lower limit, the basal delivery will be stopped.
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
#### 1.2.3 [Simulink_requirement_item_32] Units conversion
2.3 Units conversion <http://localhost:31415/matlab/feval/rmiobjnavigate?arguments=%5b%22Supervisory.slx%22,%22:18%22%5d>
Because bolus delivery and basal delivery are of different time scale. The units used for both of them will be different. The direct output of the bolus control chart is units/s. The direct output of basal control chart is Units/hr. Both of them needs to be converted to rev/min for the speed controller to react. Information of the hardware shall be provided to enable accurate unit conversion. Here is the required information:
1. Number of unit of medicine per mm^3
2. Cross-sectional area of reservoir in mm^2
3. Lead screw parameter inch/rev
4. Gear reduction ratio
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
##### 1.2.3.1 [Simulink_requirement_item_33] Convert Bolus Magnitude
2.3.1 Convert Bolus Magnitude <http://localhost:31415/matlab/feval/rmiobjnavigate?arguments=%5b%22Supervisory.slx%22,%22:31%22%5d>
This portion of the controller shall convert units/s to rev/min.
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
##### 1.2.3.2 [Simulink_requirement_item_34] Convert Basal Rate
2.3.2 Convert Basal Rate <http://localhost:31415/matlab/feval/rmiobjnavigate?arguments=%5b%22Supervisory.slx%22,%22:22%22%5d>
This portion of the controller shall convert units/hr to rev/min.
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
##### 1.2.3.3 [Simulink_requirement_item_35] Composition of delivery rate
2.3.3 Composition of delivery rate <http://localhost:31415/matlab/feval/rmiobjnavigate?arguments=%5b%22Supervisory.slx%22,%22:21%22%5d>
Because the basal rate is usually very low compared with bolus magnitude, the algorithm shall add the two speed command together to get
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
##### 1.2.3.4 [Simulink_requirement_item_36] Convert displacement measurement into number of units
2.3.4 Convert displacement measurement into number of units <http://localhost:31415/matlab/feval/rmiobjnavigate?arguments=%5b%22InfusionPumpSoftwareModel.slx%22,%22:57%22%5d>
The direct measurement from the piston shall be in distance. The algorithm shall convert its unit in distance into number of units
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
### 1.3 [Simulink_requirement_item_37] Motor Speed Controller
3. Motor Speed Controller <http://localhost:31415/matlab/feval/rmiobjnavigate?arguments=%5b%22InfusionPumpSoftwareModel.slx%22,%22:307%22%5d>
The speed controller for the motor shall achieve the desired speed with adequate accuracy by controlling voltage. The feedback measurement is used to enhance the transient performance.
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
#### 1.3.1 [Simulink_requirement_item_38] Reference motor speed limit
3.1 Reference motor speed limit <http://localhost:31415/matlab/feval/rmiobjnavigate?arguments=%5b%22MotorController.slx%22,%22:14%22%5d>
Due to the hardware limitation, the reference speed shall be bounded between lower and upper limit.
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
#### 1.3.2 [Simulink_requirement_item_39] Reference motor speed filter
3.2 Reference motor speed filter <http://localhost:31415/matlab/feval/rmiobjnavigate?arguments=%5b%22MotorController.slx%22,%22:4%22%5d>
The reference motor speed shall be filtered by a low pass filter
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
#### 1.3.3 [Simulink_requirement_item_40] Feedforward lookup table based on reference motor speed
3.3 Feedforward lookup table based on reference motor speed <http://localhost:31415/matlab/feval/rmiobjnavigate?arguments=%5b%22MotorController.slx%22,%22:15%22%5d>
The controller shall be able to change the motor speed based on reference motor speed. The lookup table shall be calibrated using steady state test.
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
#### 1.3.4 [Simulink_requirement_item_41] Feedback Controller
3.4 Feedback Controller <http://localhost:31415/matlab/feval/rmiobjnavigate?arguments=%5b%22MotorController.slx%22,%22:5%22%5d>
The feedback part of this controller shall minimize speed error when the pump is working with parameter setting that is different from the steady state. The controller shall have the following features:
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
##### 1.3.4.1 [Simulink_requirement_item_42] 1. controller shall be driven by the different between reference motor speed ...
1. controller shall be driven by the different between reference motor speed and actual motor speed

##### 1.3.4.2 [Simulink_requirement_item_43] 2. controller shall be a PI structure

##### 1.3.4.3 [Simulink_requirement_item_44] 3. controller P gain shall be tunable with respect to different speed

##### 1.3.4.4 [Simulink_requirement_item_45] 4. controller I gain shall be tunable with respect to different speed

#### 1.3.5 [Simulink_requirement_item_46] Superimpose Command
3.5 Superimpose Command <http://localhost:31415/matlab/feval/rmiobjnavigate?arguments=%5b%22MotorController.slx%22,%22:3%22%5d>
The feedforward controller and the feedback controller shall be combined together.
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
#### 1.3.6 [Simulink_requirement_item_47] Voltage Command Rate Limitation
3.6 Voltage Command Rate Limitation <http://localhost:31415/matlab/feval/rmiobjnavigate?arguments=%5b%22MotorController.slx%22,%22:13%22%5d>
Considering the power limitation, the voltage command rate shall be limited to +-10 volts/s
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
### 1.4 [Simulink_requirement_item_57] Fault Detector
4. Fault Detector <http://localhost:31415/matlab/feval/rmiobjnavigate?arguments=%5b%22InfusionPumpSoftwareModel.slx%22,%22:309%22%5d>
The function of the Fault Detector is to trigger the alert when a physical occlusion is happening. The fault detector needs report occlusion within 30 seconds of the event.
There could be two options of fault detector:
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
#### 1.4.1 [Simulink_requirement_item_61] Occlusion Detection Option 1
4.1 Occlusion Detection Option 1 <http://localhost:31415/matlab/feval/rmiobjnavigate?arguments=%5b%22OcclusionDetection.slx%22,%22:3%22%5d>
The specific algorithm is designed based on signal processing and constant threshold.
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
#### 1.4.2 [Simulink_requirement_item_62] Occlusion Detection Option 2
4.2 Occlusion Detection Option 2 <http://localhost:31415/matlab/feval/rmiobjnavigate?arguments=%5b%22OcclusionDetection.slx%22,%22:18%22%5d>
The specific algorithm is designed based on Support Vector Machine (SVM).
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